# Grasshopper definition Wasp_BasicExample.gh (Grasshopper 1.0.8)

# ----
# Press the button to make sure the file is
# updated to latest Wasp version on your pc.
button = Button()
# 0_01_Basic_Aggregation
updatefile = Wasp_UpdateFile(UPDATE=button)  # -> LOG; inputs UPDATE: Boolean; plug-in component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

# ----
# 1. Build Part
# Parts are the building blocks of Wasp.
# The most basic way of initializing a part is to define t he geometry (as brep or mesh),
# and the connection faces (center and orientation - with a line). Parts must be named
# to be identifyed in the aggregation rules.
connections_centers = Point([<point referenced from the Rhino model> x3])
connections_x_axis = Curve([<curve referenced from the Rhino model> x3])
part_geometry = Brep(<brep referenced from the Rhino model>)
conndir = Wasp_ConnectionFromDirection(GEO=part_geometry, CEN=connections_centers, UP=connections_x_axis)  # -> CONN, PLN_OUT; inputs GEO: Mesh, CEN: list of Point3d, UP: list of Curve, T: list; plug-in component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
# # Wasp: Discrete Design with Grasshopper plug-in (GPL) initiated by Andrea Rossi
# 
# 
# This file is part of Wasp.
# 
# Copyright (c) 2021, Andrea Rossi <a.rossi.andrea@gmail.com>
# 
# Wasp is free software; you can redistribute it and/or modify it under the terms of the GNU General Public License as published by the Free Software Foundation; either version 3 of the License, or (at your option) any later version.
# 
# Wasp is distributed in the hope that it will be useful, but WITHOUT ANY WARRANTY; without even the implied warranty of MERCHANTABILITY or FITNESS FOR A PARTICULAR PURPOSE. See the GNU General Public License for more details. You should have received a copy of the GNU General Public License
#  along with Wasp; If not, see <http://www.gnu.org/licenses/>.
# 
# license GPL-3.0 <https://www.gnu.org/licenses/gpl.html>
# 
# Significant parts of Wasp have been developed by Andrea Rossi as part of research on digital materials and discrete design at DDU Digital Design Unit - Prof. Oliver Tessmann - Technische Universität Darmstadt
part_name = Panel("HEXA")
points = PointList(Points=connections_centers, Size=Slider(2, range=0..10))
part = Wasp_BasicPart(NAME=part_name, GEO=part_geometry, CONN=flatten(conndir.CONN))  # -> PART; inputs GEO: Mesh, CONN: list, ATTR: list; plug-in component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

# ----
# 2. Define aggregation rules
# Rules define which connection of which part can be
# connected with each other to for the aggregation.
# 
# NB: Rules are directional! So if you want to connect 1 to 2 and 2 to 1,
# you need to write two separate rules.
number_slider = Slider(0, range=0..10)
part_name_2 = Panel("HEXA")
rule = Wasp_Rule(P1=part_name_2, C1=number_slider, P2=part_name_2, C2=Slider(0, range=0..10))  # -> R; inputs C1: Int32, C2: Int32; plug-in component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
rule_2 = Wasp_Rule(P1=part_name_2, C1=Slider(0, range=0..10), P2=part_name_2, C2=Slider(1, range=0..10))  # -> R; inputs C1: Int32, C2: Int32; plug-in component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
rule_3 = Wasp_Rule(P1=part_name_2, C1=Slider(2, range=0..10), P2=part_name_2, C2=Slider(1, range=0..10))  # -> R; inputs C1: Int32, C2: Int32; plug-in component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
merge = Merge(Data1=rule, Data2=rule_2, Data3=rule_3)

# ----
# 3. Aggregate!
# Stochastic Aggregation builds an aggregation by randomly selecting one part
# and one rule to be applied at every step.
# The component adds parts additively over the already aggregated parts.
# If a new aggregation has to be created, the RESET button allows to reset
# the aggregation and restart.
parts_num = Slider(100, range=0..1000)
reset = Button()
stochasticaggregation = Wasp_StochasticAggregation(PART=flatten(part), N=parts_num, RULES=merge, RESET=reset)  # -> AGGR, PART_OUT; inputs PART: list, PREV: list, N: Int32, RULES: list, SEED: Int32, MODE: Int32, GC: list, RESET: Boolean; plug-in component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

serialize = Wasp_SerializeObjectToFile(OBJ=stochasticaggregation.AGGR)  # -> KEY, FILE; inputs FILTER: list, SAVE: Boolean; plug-in component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

# ----
# 4. Visualize
# In order to visualize the result, it is necessary to extract
# the part geometry from the part itself.
partgeo = Wasp_GetPartGeometry(PART=stochasticaggregation.PART_OUT)  # -> GEO; plug-in component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
preview = CustomPreview(Geometry=partgeo, Material=ColourSwatch(SwatchColor=RGB(119, 255, 0)))
